# Grasshopper definition test.gh (Grasshopper 1.0.7)
# plug-ins: PicoGH

point = Point([<point referenced from the Rhino model> x4])
interpolate = Interpolate(Vertices=point, Degree=3, Periodic=False, KnotStyle=2)  # -> Curve, Length, Domain
number_slider = Slider(3, range=0..10)
perp_frames = PerpFrames(Curve=interpolate.Curve, Count=Slider(34, range=5..50), Align=True)  # -> Frames, Parameters
picopipe = PicoPipe(Frames=perp_frames.Frames, OuterRadius=number_slider, InnerRadius=Slider(3.3, range=0..10))  # disabled
picosphere = PicoSphere(Centre=perp_frames.Frames, Radius=number_slider)  # disabled
picobox = PicoBox(Frames=perp_frames.Frames)
picolistunion = PicoListUnion(Input=picosphere)
